# Grasshopper definition Chapter3.gh (Grasshopper 1.0.7)

# ---- group: Create new Point
c_script = CSharpScript(x=Slider(19.63, range=0..100), y=Slider(51.27, range=0..100), z=Slider(79.63, range=0..100))  # -> out, Point; inputs x: Double, y: Double, z: Double
# ---------- c_script: C# ----------
    //create an instance of a point and initialize to x,y, and z
    Point3d pt = new Point3d (x, y, z);
    
    //assign the point "pt" to output
    Point = pt;
# ---------- end c_script ----------
panel = Panel(c_script.Point)

# ---- group: Dissecting the Point, taking out x, y, and z
point = Point(Point(19.63, 51.27, 79.63))
c_script_2 = CSharpScript(pt=point)  # -> out, A, B, C; inputs pt: Point3d
# ---------- c_script_2: C# ----------
    A = pt.X;
    B = pt.Y;
    C = pt.Z;
# ---------- end c_script_2 ----------
panel_2 = Panel(c_script_2.C)
panel_3 = Panel(c_script_2.B)
panel_4 = Panel(c_script_2.A)

# ---- group: Creating a point and finding the distance of it to another point
point_2 = Point(Point(0, 5, 0))
panel_5 = Panel(point_2)
c_script_3 = CSharpScript(x=Slider(1, range=1..10), y=Slider(2, range=1..10), z=Slider(3, range=1..10), other=panel_5)  # -> out, Point, Distance; inputs x: Double, y: Double, z: Double, other: Point3d
# ---------- c_script_3: C# ----------
    Point3d pt = new Point3d(x, y, z);
    double dist = pt.DistanceTo(other);
    Point = pt;
    Distance = dist;
# ---------- end c_script_3 ----------
panel_6 = Panel(c_script_3.Point)
panel_7 = Panel(c_script_3.Distance)

# ---- group: Creating new Point, first making it null then adding the points in there
c_script_4 = CSharpScript(x=Slider(2.1, range=0..10), y=Slider(3.1, range=0..10), z=Slider(4.1, range=0..10))  # -> out, Point; inputs x: Double, y: Double, z: Double
# ---------- c_script_4: C# ----------
    //declare a new point
    Point3d newPoint = new Point3d (Point3d.Unset);

    //set "newPoint" coordinates
    newPoint.X = x;
    newPoint.Y = y;
    newPoint.Z = z;

    //assign the point coordinates to output
    Point = newPoint;
# ---------- end c_script_4 ----------
panel_8 = Panel(c_script_4.Point)

# ---- group: Get the origin points
c_script_5 = CSharpScript()  # -> out, Origin
# ---------- c_script_5: C# ----------
    Origin = Point3d.Origin;
# ---------- end c_script_5 ----------
panel_9 = Panel(c_script_5.Origin)

# ---- group: Moving point by Transform (Vector3d)
move = Move(Motion="4,5,6")  # -> Geometry, Transform
point_3 = Point(Point(0, 5, 0))
c_script_6 = CSharpScript(Point=point_3, xform=move.Transform)  # -> out, newPt; inputs Point: Point3d, xform: Transform
# ---------- c_script_6: C# ----------
    Point3d pt = new Point3d(Point);
    pt.Transform(xform);
    newPt = pt;
# ---------- end c_script_6 ----------
panel_10 = Panel(c_script_6.newPt)

# ---- group: Checks if the list of points are co-planar
panel_11 = Panel("""4,5,6
1,1,6
0,0,6""")
c_script_7 = CSharpScript(pts=panel_11, tolerance="0.01")  # -> out, IsCoPlanar; inputs pts: list of Point3d, tolerance: Double
# ---------- c_script_7: C# ----------
    //Test if the list of input points are coplanar
    bool coplaner = Point3d.ArePointsCoplanar(pts, tolerance);
    
    //assign the co-planar test to output
    IsCoPlanar = coplaner;
# ---------- end c_script_7 ----------
panel_12 = Panel(c_script_7.IsCoPlanar)
